# Grasshopper definition Test Script.ghx (Grasshopper 0.9.65)
# plug-ins: Python Interpreter

contour_spacing = Slider(50, range=10..10000)
max_floor = Slider(2500, range=0..5000)
min_floor = Slider(1250, range=-5000..5000)
waiwhetu_surface = Brep(<brep referenced from the Rhino model>)
waterfront_surface = Brep(<brep referenced from the Rhino model>)
waterfront_boundary = Curve(<curve referenced from the Rhino model>)
waiwhetu_boundary = Curve(<curve referenced from the Rhino model>)
bake_curves = BooleanToggle(False)
xy = XYPlane(Origin=Point(0, 0, 0))
mesh = Mesh(<mesh referenced from the Rhino model>)
mesh_2 = MeshBrep(
    Brep=waterfront_surface,
    Settings={GridMaxCount=0, GridMinCount=16, JaggedSeams=False, MaxEdgeLength=0, MinEdgeLength=0.0001, MinTolerance=0, Refine=True, RefineAngle=0, RelativeTolerance=0.65, SimplePlanes=True, Tolerance=0})
crv = Curve(waterfront_boundary)
this_is_python = PythonScript()  # -> out, a
# ---------- this_is_python: Python ----------
import Rhino
import rhinoscriptsyntax as rs
 
# data passed to the RTree's SearchCallback function that
# we can use for recording what is going on
class SearchData:
    def __init__(self, mesh, point):
        self.HitCount = 0
        self.Mesh = mesh
        self.Point = point
        self.Index = -1
        self.Distance = 0
 
 
def SearchCallback(sender, e):
    data = e.Tag
    data.HitCount += 1
    vertex = data.Mesh.Vertices[e.Id]
    distance = data.Point.DistanceTo(vertex)
    if data.Index == -1 or data.Distance > distance:
        # shrink the sphere to help improve the test
        e.SearchSphere = Rhino.Geometry.Sphere(data.Point, distance)
        data.Index = e.Id
        data.Distance = distance
 
def RunSearch():
    id = rs.GetObject("select mesh", rs.filter.mesh)
    mesh = rs.coercemesh(id)
    if mesh:
        rs.UnselectObject(id)
        tree = Rhino.Geometry.RTree()
        # I can add a RhinoCommon function that just builds an rtree from the
        # vertices in one quick shot, but for now...
        for i,vertex in enumerate(mesh.Vertices): tree.Insert(vertex, i)
 
        while(True):
            point = rs.GetPoint("test point")
            if not point: break
 
            data = SearchData(mesh, point)
            # Use the first vertex in the mesh to define a start sphere
            distance = point.DistanceTo(mesh.Vertices[0])
            sphere = Rhino.Geometry.Sphere(point, distance * 1.1)
            if tree.Search(sphere, SearchCallback, data):
                rs.AddPoint(mesh.Vertices[data.Index])
                print "Found point in {0} tests".format(data.HitCount)
 
if __name__=="__main__":
    RunSearch()
# ---------- end this_is_python ----------
this_is_vb = VBScript()  # -> out, A
# ---------- this_is_vb: VB additional code ----------
  Imports Rhino
  Imports Rhino.Geometry
 
  Namespace examples_vb
    <System.Runtime.InteropServices.Guid("B89D4A42-A712-4FA4-9ABF-6BE1FB962D24")> _
    Public Class RTreeClosestPoint
      Inherits Rhino.Commands.Command
      Public Overrides ReadOnly Property EnglishName() As String
        Get
          Return "vb_RtreeClosestPoint"
        End Get
      End Property
 
      Private Sub SearchCallback(sender As Object, e As RTreeEventArgs)
        Dim data As SearchData = TryCast(e.Tag, SearchData)
        data.HitCount = data.HitCount + 1
        Dim vertex As Point3f = data.Mesh.Vertices(e.Id)
        Dim distance As Double = data.Point.DistanceTo(vertex)
        If data.Index = -1 OrElse data.Distance > distance Then
          ' shrink the sphere to help improve the test
          e.SearchSphere = New Sphere(data.Point, distance)
          data.Index = e.Id
          data.Distance = distance
        End If
      End Sub
 
      Private Class SearchData
        Public Sub New(mesh__1 As Mesh, point__2 As Point3d)
          Point = point__2
          Mesh = mesh__1
          HitCount = 0
          Index = -1
          Distance = 0
        End Sub
 
        Public Property HitCount As Integer
        Public Property Point As Point3d
        Public Property Mesh As Mesh
        Public Property Index As Integer
        Public Property Distance As Double
          End Class
 
        Protected Overrides Function RunCommand(doc As RhinoDoc, mode As Rhino.Commands.RunMode) As Rhino.Commands.Result
          Dim objref As Rhino.DocObjects.ObjRef = Nothing
          Dim rc = Rhino.Input.RhinoGet.GetOneObject("select mesh", False, Rhino.DocObjects.ObjectType.Mesh, objref)
          If rc <> Rhino.Commands.Result.Success Then
            Return rc
          End If
 
          Dim mesh As Mesh = objref.Mesh()
          objref.Object().Select(False)
          doc.Views.Redraw()
 
          Using tree As New RTree()
            For i As Integer = 0 To mesh.Vertices.Count - 1
              ' we can make a C++ function that just builds an rtree from the
              ' vertices in one quick shot, but for now...
              tree.Insert(mesh.Vertices(i), i)
            Next
 
            Dim point As Point3d
            While True
              rc = Rhino.Input.RhinoGet.GetPoint("test point", False, point)
              If rc <> Rhino.Commands.Result.Success Then
                Exit While
              End If
 
              Dim data As New SearchData(mesh, point)
              ' Use the first vertex in the mesh to define a start sphere
              Dim distance As Double = point.DistanceTo(mesh.Vertices(0))
              Dim sphere As New Sphere(point, distance * 1.1)
              If tree.Search(sphere, AddressOf SearchCallback, data) Then
                doc.Objects.AddPoint(mesh.Vertices(data.Index))
                doc.Views.Redraw()
                RhinoApp.WriteLine("Found point in {0} tests", data.HitCount)
              End If
            End While
          End Using
          Return Rhino.Commands.Result.Success
        End Function
      End Class
      End Namespace
# ---------- end this_is_vb ----------
this_is_c = CSharpScript()  # -> out, A
# ---------- this_is_c: C# additional code ----------
  using System;
  using Rhino;
  using Rhino.Geometry;
 
  namespace examples_cs
  {
    [System.Runtime.InteropServices.Guid("0E82E6DA-5335-453A-AC94-2499BBBCBE55")]
    public class RTreeClosestPoint : Rhino.Commands.Command
    {
      public override string EnglishName { get { return "cs_RtreeClosestPoint"; } }
 
      void SearchCallback(object sender, RTreeEventArgs e)
      {
        SearchData data = e.Tag as SearchData;
        if (data == null)
          return;
        data.HitCount = data.HitCount + 1;
        Point3f vertex = data.Mesh.Vertices[e.Id];
        double distance = data.Point.DistanceTo(vertex);
        if (data.Index == -1 || data.Distance > distance)
        {
          // shrink the sphere to help improve the test
          e.SearchSphere = new Sphere(data.Point, distance);
          data.Index = e.Id;
          data.Distance = distance;
        }
      }
 
      class SearchData
      {
        public SearchData(Mesh mesh, Point3d point)
        {
          Point = point;
          Mesh = mesh;
          HitCount = 0;
          Index = -1;
          Distance = 0;
        }
 
        public int HitCount { get; set; }
        public Point3d Point { get; private set; }
        public Mesh Mesh { get; private set; }
        public int Index { get; set; }
        public double Distance { get; set; }
      }
 
      protected override Rhino.Commands.Result RunCommand(RhinoDoc doc, Rhino.Commands.RunMode mode)
      {
        Rhino.DocObjects.ObjRef objref;
        var rc = Rhino.Input.RhinoGet.GetOneObject("select mesh", false, Rhino.DocObjects.ObjectType.Mesh, out objref);
        if (rc != Rhino.Commands.Result.Success)
          return rc;
 
        Mesh mesh = objref.Mesh();
        objref.Object().Select(false);
        doc.Views.Redraw();
 
        using (RTree tree = new RTree())
        {
          for (int i = 0; i < mesh.Vertices.Count; i++)
          {
            // we can make a C++ function that just builds an rtree from the
            // vertices in one quick shot, but for now...
            tree.Insert(mesh.Vertices[i], i);
          }
 
          while (true)
          {
            Point3d point;
            rc = Rhino.Input.RhinoGet.GetPoint("test point", false, out point);
            if (rc != Rhino.Commands.Result.Success)
              break;
 
            SearchData data = new SearchData(mesh, point);
            // Use the first vertex in the mesh to define a start sphere
            double distance = point.DistanceTo(mesh.Vertices[0]);
            Sphere sphere = new Sphere(point, distance * 1.1);
            if (tree.Search(sphere, SearchCallback, data))
            {
              doc.Objects.AddPoint(mesh.Vertices[data.Index]);
              doc.Views.Redraw();
              RhinoApp.WriteLine("Found point in {0} tests", data.HitCount);
            }
          }
        }
        return Rhino.Commands.Result.Success;
      }
    }
  }
# ---------- end this_is_c ----------
mesh_3 = Mesh(mesh_2)
P = Plane(xy)
D = Number(contour_spacing)
mcomp = Decompose(Mesh=mesh_3)  # -> Vertices, Faces, Colours, Normals
pcomp = Decompose(Point=mcomp.Vertices)  # -> XComponent, YComponent, ZComponent
sort = SortList(Keys=pcomp.ZComponent)  # -> List, ValuesA
item = ListItem(List=reverse(sort.List), Index=0, Wrap=False)
item_2 = ListItem(List=sort.List, Index=0, Wrap=False)
h_min = Number(item_2)
h_max = Number(item)
subtraction = Subtraction(A=h_min, B=contour_spacing)
subtraction_2 = Subtraction(A=h_max, B=h_min)
division = Division(A=subtraction_2, B=D)
series = Series(Start=subtraction, Step=D, Count=division)
pl_offset = PlaneOffset(BasePlane=P, Offset=series)
sec = MeshPlane(Mesh=mesh_3, Plane=pl_offset)
clean = CleanTree(Data=sec, CleanInvalid=True, CleanEmpty=False)
crv_2 = Curve(flatten(clean))
join = JoinCurves(Curves=crv_2, Preserve=False)
smoothpline = SmoothPolyline(Polyline=join, Strength=1, Times=3)
crv_3 = Curve(flatten(smoothpline))
closing_the_contours = PythonScript(curves=crv_3, boundary=crv)  # -> out, fixed_curves, a
# ---------- closing_the_contours: Python ----------
import rhinoscriptsyntax as rs

fixed_curves = []
# Temp test:
a = []

edges = rs.ExplodeCurves(boundary)
north_edge = edges[2]
east_edge = edges[1]
south_edge = edges[0]
west_edge = edges[3]

SEpoint = rs.CurveStartPoint(east_edge)
NEpoint = rs.CurveEndPoint(east_edge)

for item in curves:
    if rs.IsCurveClosed(item) == False:
        original_height = rs.CurveStartPoint(item)[2]
        movement = (0, 0, (0 - original_height))
        rs.MoveObject(item, movement)
        # Temp test:
        a.append(item)
        north_intersections = rs.CurveCurveIntersection(item, north_edge)
        east_intersections = rs.CurveCurveIntersection(item, east_edge)
        south_intersections = rs.CurveCurveIntersection(item, south_edge)
        west_intersections = rs.CurveCurveIntersection(item, west_edge)
        
        # If they intersect twice on the same edge, close em
        try:
            if north_intersections[1][2]:
                joiner = rs.AddLine(rs.CurveEndPoint(item), rs.CurveStartPoint(item))
                new_curve = rs.JoinCurves((item, joiner))
                rs.MoveObject(new_curve, (0, 0, (original_height)))
                fixed_curves.append(new_curve[0])
        except:
            print Exception
            print "not a thing"
            
        try:
            if east_intersections[1][2]:
                joiner = rs.AddLine(rs.CurveEndPoint(item), rs.CurveStartPoint(item))
                new_curve = rs.JoinCurves((item, joiner))
                rs.MoveObject(new_curve, (0, 0, (original_height)))
                fixed_curves.append(new_curve[0])
        except:
            print Exception
            print "not a thing"
            
        try:
            if south_intersections[1][2]:
                joiner = rs.AddLine(rs.CurveEndPoint(item), rs.CurveStartPoint(item))
                new_curve = rs.JoinCurves((item, joiner))
                rs.MoveObject(new_curve, (0, 0, (original_height)))
                fixed_curves.append(new_curve[0])
        except:
            print Exception
            print "not a thing"
            
        try:
            if west_intersections[1][2]:
                joiner = rs.AddLine(rs.CurveEndPoint(item), rs.CurveStartPoint(item))
                new_curve = rs.JoinCurves((item, joiner))
                rs.MoveObject(new_curve, (0, 0, (original_height)))
                fixed_curves.append(new_curve[0])
        except:
            print Exception
            print "not a thing"
            

        # If the intersect on diagonal edges
        try:
            if (east_intersections[0][1]) and (south_intersections[0][1]):
                search_points = (rs.CurveEndPoint(item), rs.CurveStartPoint(item))
                # Finding the proper end point
                east_start = rs.PointArrayClosestPoint(search_points, east_intersections[0][1])
                south_start = rs.PointArrayClosestPoint(search_points, south_intersections[0][1])
                # Drawing lines to the edge boundary
                joinerb = rs.AddLine(search_points[south_start], SEpoint)
                joinera = rs.AddLine(search_points[east_start], SEpoint)
                new_curve = rs.JoinCurves((item, joinera, joinerb))
                rs.MoveObject(new_curve, (0, 0, (original_height)))
                fixed_curves.append(new_curve[0])
        except:
            print "no east and south ix"

        try:
            if (east_intersections[0][1]) and (north_intersections[0][1]):
                search_points = (rs.CurveEndPoint(item), rs.CurveStartPoint(item))
                # Finding the proper end point
                east_start = rs.PointArrayClosestPoint(search_points, east_intersections[0][1])
                north_start = rs.PointArrayClosestPoint(search_points, north_intersections[0][1])
                # Drawing lines to the edge boundary
                joinerb = rs.AddLine(search_points[north_start], NEpoint)
                joinera = rs.AddLine(search_points[east_start], NEpoint)
                new_curve = rs.JoinCurves((item, joinera, joinerb))
                rs.MoveObject(new_curve, (0, 0, (original_height)))
                fixed_curves.append(new_curve[0])
        except:
            print Exception
            print "no east and north ix"

        try:
            if (north_intersections[0][1]) and (south_intersections[0][1]):
                search_points = (rs.CurveEndPoint(item), rs.CurveStartPoint(item))
                # Finding the proper end point
                north_start = rs.PointArrayClosestPoint(search_points, north_intersections[0][1])
                south_start = rs.PointArrayClosestPoint(search_points, south_intersections[0][1])
                # Drawing lines to the edge boundary
                joinera = rs.AddLine(search_points[north_start], NEpoint)
                joinerb = rs.AddLine(search_points[south_start], SEpoint)
                joinerc = rs.AddLine(NEpoint, SEpoint)
                new_curve = rs.JoinCurves((item, joinera, joinerb, joinerc))
                rs.MoveObject(new_curve, (0, 0, (original_height)))
                fixed_curves.append(new_curve[0])
        except:
            print Exception
            print "no north and south ix"

            
    else:
        fixed_curves.append(item)
# ---------- end closing_the_contours ----------
crv_4 = Curve(closing_the_contours.a)
crv_5 = Curve(closing_the_contours.fixed_curves)
colouring_the_contours = PythonScript(curves=crv_5, floor_min=min_floor, floor_max=max_floor)  # -> out, contours, layer_names, parameters
# ---------- colouring_the_contours: Python ----------
import math
import rhinoscriptsyntax as rs

contour_heights = []
parameters = []
contours = []
layer_names = []

# Gathering all the height options
for item in curves:
    height = rs.CurveStartPoint(item)[2]
    if height < floor_min:
        print 'skipped'
        # This height is a flooring minimum
    elif height > floor_max:
        print 'skipped'
        # This height is a flooring maximum
    else:
        contour_heights.append(height)
        if rs.IsCurveClosed(item):
            contours.append(rs.CloseCurve(item))
        else:
            contours.append(item)
        
        

processed_heights = list(set(contour_heights))
processed_heights.sort()

low = min(processed_heights)
high = max(processed_heights)
amount = len(processed_heights)

print low
print high
print amount

print processed_heights

# Processing all the height options
for item in contours:
    index = processed_heights.index(rs.CurveStartPoint(item)[2]) + 2
    param = index / amount
    layer_name = "Contours @ %i" % (rs.CurveStartPoint(item)[2])
    layer_names.append(layer_name)
    parameters.append(param)
# ---------- end colouring_the_contours ----------
gradient = Gradient(
    LowerLimit=0,
    UpperLimit=1,
    Parameter=colouring_the_contours.parameters,
    stops=[0.0963: RGB(30, 144, 255), 1: RGB(192, 0, 192)])
gradient_2 = Gradient(
    LowerLimit=0,
    UpperLimit=1,
    Parameter=colouring_the_contours.parameters,
    stops=[0: RGB(255, 0, 0), 0.503: RGB(255, 255, 0), 1: RGB(0, 255, 0)])
gradient_3 = Gradient(
    LowerLimit=0,
    UpperLimit=1,
    Parameter=colouring_the_contours.parameters,
    stops=[0.00607: RGB(255, 255, 255), 0.998: RGB(0, 0, 0)])
str = String(colouring_the_contours.layer_names)
crv_6 = Curve(colouring_the_contours.contours)
col = Colour(gradient_3)
preview = CustomPreview(Geometry=crv_6, Shader=col)
