# Grasshopper definition unnamed.ghx (Grasshopper 0.9.6)
# plug-ins: Python Interpreter

this_is_vb_code = VBScript()  # -> out, A
# ---------- this_is_vb_code: VB additional code ----------
  this Is my actual VB code
  
  it is a bit shit
# ---------- end this_is_vb_code ----------
this_is_not_code = Vector()
this_is_c_code = CSharpScript()  # -> out, A
# ---------- this_is_c_code: C# additional code ----------
yo heres my actual C# code. its bad.
  
  "wtf"
# ---------- end this_is_c_code ----------
this_is_python_code = PythonScript()  # -> out, a
# ---------- this_is_python_code: Python ----------
# this is python code

for i in list():
    print something
    
    
print booga
# ---------- end this_is_python_code ----------
